# Grasshopper definition Tower.gh (Grasshopper 1.0.7)

# ---- group: RH_IN:Rotation
number_slider = Slider(251, range=0..360)

# ---- group: RH_IN:Steps
number_slider_2 = Slider(13, range=3..100)

# ---- group: RH_IN:Radius
number_slider_3 = Slider(42, range=3..100)

# ---- group: RH_IN:Segments
number_slider_4 = Slider(5, range=3..12)

# ----
construct_domain = ConstructDomain(DomainStart=0, DomainEnd=number_slider)
series = Series(Start="0", Step=number_slider_2, Count=10)
polygon = Polygon(Plane=PlaneXY(0, 0, 0), Radius=number_slider_3, Segments=number_slider_4, FilletRadius=0)  # -> Polygon, Length
unit_z = UnitZ(Factor=series)
move = Move(Geometry=polygon.Polygon, Motion=unit_z)  # -> Geometry, Transform
curve = Curve(move.Geometry)
list_length = ListLength(List=curve)
subtraction = Subtraction(A=list_length, B="1")
range = Range(Domain=construct_domain, Steps=subtraction)
radians = Radians(Degrees=range)
rotate = Rotate(Geometry=curve, Angle=radians, Plane=PlaneXY(0, 0, 0))  # -> Geometry, Transform
curve_2 = Curve(rotate.Geometry)
loft = Loft(Curves=curve_2, Options={Adjust=False, Closed=False, LoftEnds=0, LoftSimp=0, LoftType=0, Rebuild=10, Refit=0.01})
cap = CapHoles(Brep=loft)

# ---- group: RH_OUT:surface
mesh = Mesh(cap)
